# Grasshopper definition Grass.gh (Grasshopper 1.0.8)

rec_2pt = Rectangle2Pt(Plane=PlaneXY(0, 0, 0), PointA=Point(0, 0, 0), PointB=Point(10, 5, 0), Radius=0)  # -> Rectangle, Length
data = Data(rec_2pt.Rectangle)
Z = UnitZ(Factor=Slider(10, range=0..10))
extr = Extrude(Base=rec_2pt.Rectangle, Direction=Z)
